# Grasshopper definition Chair_Global Geo with fibers.gh (Grasshopper 1.0.7)
# plug-ins: Kangaroo Components, Pufferfish, NGon, Parakeet, karambaGH, Kangaroo2 Components, Bifocals

division = Division(A=Slider(600, range=0..1000), B=2)
polygon = Polygon(Plane=PlaneXY(0, 0, 0), Radius=division, Segments=Slider(3, range=0..10), FilletRadius=0)  # -> Polygon, Length
explode = Explode(Curve=polygon.Polygon, Recursive=True)  # -> Segments, Vertices
area = Area(Geometry=polygon.Polygon)  # -> Area, Centroid
midpt = CurveMiddle(Curve=explode.Segments)
duppt = RemoveDuplicatePts(Points=explode.Vertices, Tolerance=0.01)
len = Length(Curve=explode.Segments)
points = PointList(Points=midpt)
shift = ShiftList(List=duppt, Shift=Slider(2, range=0..10), Wrap=True)
vec2pt = Vector2Pt(PointA=area.Centroid, PointB=graft(duppt), Unitize=False)  # -> Vector, Length
points_2 = PointList(Points=shift)
axis = Vector(vec2pt.Vector)
move2pt = MoveToPoint(Geometry=explode.Segments, PointA=midpt, PointB=shift)  # -> Moved, Vector, Transform
leg_end_width = Slider(0.16, range=0..1)
scale = Scale(Geometry=polygon.Polygon, Center=area.Centroid, Factor=leg_end_width)  # -> Geometry, Transform
scale_2 = Scale(Geometry=move2pt.Moved, Center=shift, Factor=leg_end_width)  # -> Geometry, Transform
len_2 = Length(Curve=scale_2.Geometry)
end = EndPoints(Curve=scale_2.Geometry)  # -> Start, End
explode_2 = Explode(Curve=scale.Geometry, Recursive=True)  # -> Segments, Vertices
shift_2 = ShiftList(List=end.End, Shift=1, Wrap=True)
geo = Geometry(end.Start)
midpt_2 = CurveMiddle(Curve=explode_2.Segments)
points_3 = PointList(Points=shift_2)
points_4 = PointList(Points=geo)
weave = Weave(Pattern=[0, 1], Stream0=graft(geo), Stream1=graft(shift_2), NullGaps=False)  # -> simplify(Weave)
shift_3 = ShiftList(List=midpt_2, Shift=-1, Wrap=True)  # -> simplify(List)
points_5 = PointList(Points=shift_3)
weave_2 = Weave(Pattern=[0, 1], Stream0=graft(shift_3), Stream1=weave, NullGaps=False)  # -> simplify(Weave)
bang = ExplodeTree(Data=weave_2)  # -> Branch0, Branch1
geo_2 = Geometry(bang.Branch0)
shift_4 = ShiftList(List=weave_2, Shift=Slider(2, range=1..2), Wrap=True)
intcrv = Interpolate(Vertices=shift_4, Degree=3, Periodic=False, KnotStyle=1)  # -> Curve, Length, Domain
surface_area_leg_length = Slider(0.4, range=0..1)
nurbs = NurbsCurve(Vertices=shift_4, Degree=2, Periodic=False)  # -> Curve, Length, Domain
crv = Curve(graft(scale_2.Geometry))
midpt_3 = CurveMiddle(Curve=flatten(nurbs.Curve))
midpt_4 = CurveMiddle(Curve=flatten(crv))
subtraction = Subtraction(A=1, B=surface_area_leg_length)
points_6 = PointList(Points=midpt_4)
eval = EvaluateCurve(Curve=reparameterize(nurbs.Curve), Parameter=subtraction)  # -> Point, Tangent, Angle
eval_2 = EvaluateCurve(Curve=reparameterize(nurbs.Curve), Parameter=surface_area_leg_length)  # -> Point, Tangent, Angle
points_7 = PointList(Points=flatten(eval.Point), Size=5)
weave_3 = Weave(Pattern=[0, 1], Stream0=nurbs.Curve, Stream1=crv, NullGaps=False)  # -> simplify(Weave)
points_8 = PointList(Points=flatten(eval_2.Point), Size=5)
shift_5 = ShiftList(List=flatten(eval.Point), Shift=1, Wrap=True)  # -> graft(List)
vec = Vector(axis)
crv_2 = Curve(flatten(weave_3))

actuator_width = Slider(0.35, range=0..1)
actuator_length = Slider(0.15, range=0..1)

dom = ConstructDomain(DomainStart=surface_area_leg_length, DomainEnd=subtraction)
dom_2 = ConstructDomain(DomainStart=subtraction, DomainEnd=1)
dom_3 = ConstructDomain(DomainStart=0, DomainEnd=surface_area_leg_length)
vlen = VectorLength(Vector=vec)
curvesort = CurveSort(CurvesGuide=polygon.Polygon, CurvesToSort=crv_2)
subcrv = SubCurve(BaseCurve=reparameterize(nurbs.Curve), Domain=dom)
subcrv_2 = SubCurve(BaseCurve=reparameterize(nurbs.Curve), Domain=dom_2)
ln = Line(StartPoint=eval_2.Point, EndPoint=shift_5)
subcrv_3 = SubCurve(BaseCurve=reparameterize(nurbs.Curve), Domain=dom_3)
crv_3 = Curve(crv)
subtraction_2 = Subtraction(A=1, B=actuator_width)
multiplication = Multiplication(A=vlen, B=actuator_length)
dom_4 = ConstructDomain(DomainStart=0, DomainEnd=actuator_width)
dom_5 = ConstructDomain(DomainStart=actuator_width, DomainEnd=subtraction_2)
dom_6 = ConstructDomain(DomainStart=subtraction_2, DomainEnd=1)
amp = Amplitude(Vector=vec, Amplitude=multiplication)
item = ListItem(List=curvesort, Index=Slider(5, range=0..5), Wrap=True)
shift_6 = ShiftList(List=flatten(subcrv_2), Shift=1, Wrap=True)  # -> graft(List)
shift_7 = ShiftList(List=flatten(crv_3), Shift=1, Wrap=True)  # -> graft(List)
weave_4 = Weave(Pattern=[0, 1], Stream0=subcrv, Stream1=ln, NullGaps=False)
subcrv_4 = SubCurve(BaseCurve=reparameterize(ln), Domain=dom_4)
subcrv_5 = SubCurve(BaseCurve=reparameterize(ln), Domain=dom_6)
subcrv_6 = SubCurve(BaseCurve=reparameterize(ln), Domain=dom_5)
shatter = Shatter(Curve=reparameterize(shift_7), Parameters=0.5)  # -> simplify(Segments)
crv_4 = Curve(flatten(weave_4))
weave_5 = Weave(Pattern=[0, 1], Stream0=subcrv_3, Stream1=shift_6, NullGaps=False)  # -> simplify(Weave)
weave_6 = Weave(Pattern=[0, 1], Stream0=subcrv_4, Stream1=subcrv_5, NullGaps=False)  # -> graft(Weave)
join = JoinCurves(Curves=crv_4, Preserve=False)  # -> simplify(Curves)
join_2 = JoinCurves(Curves=curvesort, Preserve=False)
move = Move(Geometry=subcrv_6, Motion=expr("-x", amp))  # -> Geometry, Transform
move_2 = Move(Geometry=subcrv_6, Motion=amp)  # -> Geometry, Transform
merge = Merge(Data1=weave_5, Data2=shatter)
crv_sitting_srf = Curve(simplify(join))
crv_whole_geo = Curve(join_2)
bang_2 = ExplodeTree(Data=merge)  # -> Branch0, Branch1, Branch2
end_2 = EndPoints(Curve=subcrv_6)  # -> Start, End
end_3 = EndPoints(Curve=move.Geometry)  # -> Start, End
end_4 = EndPoints(Curve=move_2.Geometry)  # -> Start, End
shatter_2 = Shatter(Curve=reparameterize(move_2.Geometry), Parameters=0.5)
crv_legs = Curve(merge)
geo_3 = Geometry(bang_2.Branch2)
brec = BoundingRectangle(Geometry=crv_whole_geo, Plane=PlaneXY(0, 0, 0), Axis=0, Slide=0, Union=True)  # -> Bounding, DimensionX, DimensionY
item_2 = ListItem(List=shatter_2, Index=0, Wrap=True)  # -> Item, Item1
points_9 = PointList(Points=end_2.Start)
brep = Brep(crv_sitting_srf)
points_10 = PointList(Points=end_3.Start)
points_11 = PointList(Points=end_4.Start)
panel = Panel(crv_legs)
item_3 = ListItem(List=geo_3, Index=Slider(3, range=0..3), Wrap=True)
crv_5 = Curve(item_2.Item)
crv_6 = Curve(item_2.Item1)
item_4 = ListItem(List=crv_legs, Index=0, Wrap=True)  # -> Item, Item1, Item2, Item3
ln_2 = Line(StartPoint=end_2.Start, EndPoint=end_3.Start)
ln_3 = Line(StartPoint=end_2.Start, EndPoint=end_4.Start)
ln_4 = Line(StartPoint=end_2.End, EndPoint=end_4.End)
ln_5 = Line(StartPoint=end_2.End, EndPoint=end_3.End)
crv_7 = Curve(subcrv)
panel_2 = Panel(join)
shatter_3 = Shatter(Curve=reparameterize(crv_7), Parameters=0.5)  # -> reverse(Segments)
shatter_4 = Shatter(Curve=reparameterize(move.Geometry), Parameters=0.5)  # -> graft(Segments)
crv_8 = Curve(weave_6)
weave_7 = Weave(Pattern=[0, 1, 2], Stream0=subcrv_4, Stream1=ln_3, Stream2=crv_5, NullGaps=False)  # -> simplify(Weave)
weave_8 = Weave(Pattern=[0, 1], Stream0=ln_2, Stream1=ln_5, NullGaps=False)
weave_9 = Weave(Pattern=[0, 1, 2], Stream0=subcrv_5, Stream1=ln_4, Stream2=crv_6, NullGaps=False)  # -> simplify(Weave)
lng = ListLength(List=shatter_3)
midpt_5 = CurveMiddle(Curve=flatten(shatter_4))
join_3 = JoinCurves(Curves=weave_7, Preserve=False)
join_4 = JoinCurves(Curves=weave_9, Preserve=False)
crv_9 = Curve(graft(weave_8))
shift_8 = ShiftList(List=flatten(shatter_3), Shift=1, Wrap=True)
item_5 = ListItem(List=flatten(lng), Index=0, Wrap=True)
points_12 = PointList(Points=midpt_5, Size=5)
midpt_6 = CurveMiddle(Curve=flatten(crv_8))
partition = PartitionList(List=shift_8, Size=item_5)  # -> graft(Chunks)
midpt_7 = CurveMiddle(Curve=flatten(crv_9))
points_13 = PointList(Points=midpt_6, Size=5)
points_14 = PointList(Points=midpt_7, Size=5)
midpt_8 = CurveMiddle(Curve=flatten(partition))
entwine = Entwine(Branch00=simplify(crv_sitting_srf), Branch01=simplify(shatter_4), Branch02=simplify(crv_9), FlattenInputs=True)
weave_10 = Weave(Pattern=[0, 1], Stream0=partition, Stream1=ln, NullGaps=False)  # -> simplify(Weave)
weave_11 = Weave(Pattern=[0, 1, 2, 3], Stream0=partition, Stream1=crv_8, Stream2=crv_9, Stream3=shatter_4, NullGaps=False)  # -> simplify(Weave)
points_15 = PointList(Points=midpt_8, Size=5)

sitting_area_boundary_curve = Curve(weave_10)
sitting_area_boundary_curve_with_actuato = Curve(entwine)  # "sitting area boundary curve (with actuator)"

geo_4 = Geometry(polygon.Polygon)
join_5 = JoinCurves(Curves=weave_11, Preserve=False)
aligncrv = AlignCurves(Curves=join_5, Guide=geo_4)  # -> simplify(Curves)
bang_3 = ExplodeTree(Data=aligncrv)  # -> Branch0, Branch1, Branch2, Branch3, Branch4, Branch5

# ----
# Curve Segments on Legs
flip = FlipCurve(Curve=item_4.Item1)  # -> Curve, Flag
flip_2 = FlipCurve(Curve=item_4.Item3)  # -> Curve, Flag
crv_e = Curve(simplify(join_3))
crv_f = Curve(simplify(join_4))
crv_a = Curve(simplify(item_4.Item))
crv_b = Curve(simplify(flip.Curve))
crv_d = Curve(simplify(item_4.Item2))
crv_c = Curve(simplify(flip_2.Curve))
merge_2 = Merge(Data1=simplify(ln), Data2=simplify(crv_a), Data3=simplify(crv_b), Data4=simplify(crv_d), Data5=simplify(crv_c))
merge_3 = Merge(Data1=crv_e, Data2=crv_f, Data3=crv_a, Data4=crv_b, Data5=crv_d, Data6=crv_c)

# ----
# Curve Segments on Sitting Srf
crv_1 = Geometry(bang_3.Branch0)
crv_4_2 = Geometry(bang_3.Branch3)
crv_5_2 = Geometry(bang_3.Branch4)
crv_6_2 = Geometry(bang_3.Branch5)
crv_2_2 = Geometry(bang_3.Branch1)
crv_3_2 = Geometry(bang_3.Branch2)

legs_without_actuator_curves = Geometry(merge_3)
sitting_crves_without_actuator_curves = Geometry(aligncrv)

sitting_area_boundary_curve_2 = Curve(sitting_area_boundary_curve)
legs_geo = Geometry(simplify(merge_2))

# ----
# Bottom Layer
number_slider = Slider(0.6, range=0..1)

number_slider_2 = Slider(0.5, range=0..1)
number_slider_3 = Slider(10, range=0..100)
number_slider_4 = Slider(7, range=0..100)
number_slider_5 = Slider(0.6, range=0..1)
number_slider_6 = Slider(4, range=0..100)

# ----
# CURVE 1 TO CURVE 6
crv_1_2 = Geometry(crv_1)
crv_6_3 = Geometry(crv_6_2)
len_3 = Length(Curve=crv_1_2)
division_2 = Division(A=len_3, B=Slider(10, range=0..10))
divide = DivideCurve(Curve=crv_6_3, Count=division_2, Kinks=False)  # -> Points, Tangents, Parameters
divide_2 = DivideCurve(Curve=crv_1_2, Count=division_2, Kinks=False)  # -> Points, Tangents, Parameters
panel_3 = Panel("""0
1
1
0""")
weave_12 = Weave(Pattern=panel_3, Stream0=reverse(divide_2.Points), Stream1=reverse(divide.Points), NullGaps=False)  # -> simplify(Weave)
pline = PolyLine(Vertices=flatten(weave_12), Closed=False)

# ----
# CURVE 4 TO CURVE 5
# Fiber Placement for Legs
crv_5_3 = Geometry(crv_5_2)
crv_4_3 = Geometry(crv_4_2)
divide_3 = DivideCurve(Curve=crv_5_3, Count=division_2, Kinks=False)  # -> Points, Tangents, Parameters
divide_4 = DivideCurve(Curve=crv_4_3, Count=division_2, Kinks=False)  # -> Points, Tangents, Parameters
weave_13 = Weave(Pattern=panel_3, Stream0=divide_4.Points, Stream1=divide_3.Points, NullGaps=False)  # -> simplify(Weave)
pline_2 = PolyLine(Vertices=weave_13, Closed=False)

# ----
# Diagonal: curve 1 to curve 4
crv_4_4 = Geometry(crv_4_2)
# Top Layer for reinforcement
crv_1_3 = Geometry(crv_1)
len_4 = Length(Curve=crv_1_3)
division_3 = Division(A=len_4, B=Slider(10, range=0..10))
divide_5 = DivideCurve(Curve=crv_4_4, Count=division_3, Kinks=False)  # -> Points, Tangents, Parameters
divide_6 = DivideCurve(Curve=crv_1_3, Count=division_3, Kinks=False)  # -> Points, Tangents, Parameters
number_slider_7 = Slider(8, range=0..13)
panel_4 = Panel("""0
1
1
0""")
weave_14 = Weave(Pattern=panel_4, Stream0=divide_6.Points, Stream1=divide_5.Points, NullGaps=False)  # -> simplify(Weave)
shift_9 = ShiftList(List=divide_5.Points, Shift=number_slider_7, Wrap=True)
ln_6 = Line(StartPoint=divide_6.Points, EndPoint=shift_9)
explode_3 = Explode(Curve=ln_6, Recursive=True)  # -> Segments, Vertices
pline_3 = PolyLine(Vertices=flatten(weave_14), Closed=False)
pline_4 = PolyLine(Vertices=flatten(explode_3.Vertices), Closed=False)

# ----
# Diagonal: curve 3 to curve 6
crv_3_3 = Geometry(crv_3_2)
crv_6_4 = Geometry(crv_6_2)
divide_7 = DivideCurve(Curve=crv_6_4, Count=division_3, Kinks=False)  # -> Points, Tangents, Parameters
divide_8 = DivideCurve(Curve=crv_3_3, Count=division_3, Kinks=False)  # -> Points, Tangents, Parameters
shift_10 = ShiftList(List=divide_7.Points, Shift=number_slider_7, Wrap=True)
weave_15 = Weave(Pattern=panel_4, Stream0=divide_8.Points, Stream1=divide_7.Points, NullGaps=False)  # -> simplify(Weave)
ln_7 = Line(StartPoint=divide_8.Points, EndPoint=shift_10)
explode_4 = Explode(Curve=ln_7, Recursive=True)  # -> Segments, Vertices
pline_5 = PolyLine(Vertices=flatten(weave_15), Closed=False)
pline_6 = PolyLine(Vertices=flatten(explode_4.Vertices), Closed=False)

# ----
# Diagonal: curve 2 to curve 5
crv_2_3 = Geometry(crv_2_2)
# Bottom Layer
crv_5_4 = Geometry(crv_5_2)
divide_9 = DivideCurve(Curve=crv_5_4, Count=division_3, Kinks=False)  # -> Points, Tangents, Parameters
divide_10 = DivideCurve(Curve=crv_2_3, Count=division_3, Kinks=False)  # -> Points, Tangents, Parameters
shift_11 = ShiftList(List=divide_9.Points, Shift=number_slider_7, Wrap=True)
weave_16 = Weave(Pattern=panel_4, Stream0=divide_10.Points, Stream1=divide_9.Points, NullGaps=False)  # -> simplify(Weave)
ln_8 = Line(StartPoint=divide_10.Points, EndPoint=shift_11)
explode_5 = Explode(Curve=ln_8, Recursive=True)  # -> Segments, Vertices
pline_7 = PolyLine(Vertices=flatten(explode_5.Vertices), Closed=False)
pline_8 = PolyLine(Vertices=flatten(weave_16), Closed=False)

# ----
# CURVE 2 TO CURVE 3
crv_3_4 = Geometry(crv_3_2)
crv_2_4 = Geometry(crv_2_2)
divide_11 = DivideCurve(Curve=crv_3_4, Count=division_2, Kinks=False)  # -> Points, Tangents, Parameters
divide_12 = DivideCurve(Curve=crv_2_4, Count=division_2, Kinks=False)  # -> Points, Tangents, Parameters
weave_17 = Weave(Pattern=panel_3, Stream0=divide_12.Points, Stream1=divide_11.Points, NullGaps=False)  # -> simplify(Weave)
pline_9 = PolyLine(Vertices=weave_17, Closed=False)

# ----
# CURVE B TO CURVE E
# +Gradient Weaving
dom_7 = ConstructDomain(DomainStart=0, DomainEnd=number_slider_2)
dom_8 = ConstructDomain(DomainStart=number_slider_2, DomainEnd=1)
dom_9 = ConstructDomain(DomainStart=number_slider_5, DomainEnd=1)
crv_b_2 = Curve(crv_b)
range = Range(Domain=dom_9, Steps=number_slider_6)
crv_e_2 = Curve(crv_e)
range_2 = Range(Domain=dom_7, Steps=number_slider_3)
range_3 = Range(Domain=dom_8, Steps=number_slider_4)
cull_i = CullIndex(List=range_2, Indices=-1, Wrap=True)
cull_i_2 = CullIndex(List=range_3, Indices=-1, Wrap=True)
merge_4 = Merge(Data1=cull_i, Data2=range_3)  # -> flatten(Result)
sort = SortList(Keys=merge_4)  # -> Keys, ValuesA
number_slider_8 = Slider(0, range=0..35)
eval_3 = EvaluateCurve(Curve=reparameterize(crv_b_2), Parameter=sort.Keys)  # -> Point, Tangent, Angle
eval_4 = EvaluateCurve(Curve=reparameterize(crv_e_2), Parameter=sort.Keys)  # -> Point, Tangent, Angle
panel_5 = Panel("""0
1
1
0""")
shift_12 = ShiftList(List=eval_3.Point, Shift=number_slider_8, Wrap=True)
weave_18 = Weave(Pattern=panel_5, Stream0=eval_4.Point, Stream1=shift_12, NullGaps=False)  # -> simplify(Weave)
pline_10 = PolyLine(Vertices=weave_18, Closed=False)
curvea_curvef = Curve(pline_10)

# ----
# CURVE A TO CURVE F
# +Gradient Weaving
crv_a_2 = Curve(crv_a)
crv_f_2 = Curve(crv_f)
end_5 = EndPoints(Curve=crv_f_2)  # -> Start, End
flip_3 = FlipCurve(Curve=crv_f_2)  # -> Curve, Flag
pt = Point(end_5.Start)
dom_10 = ConstructDomain(DomainStart=0, DomainEnd=number_slider_2)
dom_11 = ConstructDomain(DomainStart=number_slider_2, DomainEnd=1)
dom_12 = ConstructDomain(DomainStart=number_slider_5, DomainEnd=1)
range_4 = Range(Domain=dom_12, Steps=number_slider_6)
range_5 = Range(Domain=dom_10, Steps=number_slider_3)
range_6 = Range(Domain=dom_11, Steps=number_slider_4)
cull_i_3 = CullIndex(List=range_5, Indices=-1, Wrap=True)
cull_i_4 = CullIndex(List=range_6, Indices=-1, Wrap=True)
merge_5 = Merge(Data1=cull_i_3, Data2=range_6)  # -> flatten(Result)
sort_2 = SortList(Keys=merge_5)  # -> Keys, ValuesA
number_slider_9 = Slider(0, range=0..35)
eval_5 = EvaluateCurve(Curve=reparameterize(crv_a_2), Parameter=sort_2.Keys)  # -> Point, Tangent, Angle
eval_6 = EvaluateCurve(Curve=reparameterize(crv_f_2), Parameter=sort_2.Keys)  # -> Point, Tangent, Angle
panel_6 = Panel("""0
1
1
0""")
shift_13 = ShiftList(List=eval_5.Point, Shift=number_slider_8, Wrap=True)
weave_19 = Weave(Pattern=panel_6, Stream0=reverse(eval_6.Point), Stream1=shift_13, NullGaps=False)  # -> simplify(Weave)
pline_11 = PolyLine(Vertices=weave_19, Closed=False)
curvea_curvef_2 = Curve(pline_11)

# ----
# CURVE A TO CURVE B
# +Gradient Weaving
crv_b_3 = Curve(crv_b_2)
crv_a_3 = Curve(crv_a_2)
dom_13 = ConstructDomain(DomainStart=0, DomainEnd=number_slider)
dom_14 = ConstructDomain(DomainStart=number_slider, DomainEnd=1)
dom_15 = ConstructDomain(DomainStart=Slider(0.8, range=0..1), DomainEnd=1)
range_7 = Range(Domain=dom_15, Steps=Slider(5, range=0..100))
range_8 = Range(Domain=dom_13, Steps=Slider(20, range=0..100))
range_9 = Range(Domain=dom_14, Steps=Slider(4, range=0..100))
cull_i_5 = CullIndex(List=range_8, Indices=-1, Wrap=True)
cull_i_6 = CullIndex(List=range_9, Indices=-1, Wrap=True)
merge_6 = Merge(Data1=cull_i_5, Data2=cull_i_6)  # -> flatten(Result)
sort_3 = SortList(Keys=merge_6)  # -> Keys, ValuesA
eval_7 = EvaluateCurve(Curve=reparameterize(crv_b_3), Parameter=sort_3.Keys)  # -> Point, Tangent, Angle
eval_8 = EvaluateCurve(Curve=reparameterize(crv_a_3), Parameter=sort_3.Keys)  # -> Point, Tangent, Angle
panel_7 = Panel("""0
1
1
0""")
shift_14 = ShiftList(List=eval_7.Point, Shift=Slider(12, range=0..35), Wrap=True)
weave_20 = Weave(Pattern=panel_7, Stream0=eval_8.Point, Stream1=shift_14, NullGaps=False)  # -> simplify(Weave)
pline_12 = PolyLine(Vertices=weave_20, Closed=False)
crva_crvb = Curve(pline_12)

flip_4 = FlipCurve(Curve=crv_e_2)  # -> Curve, Flag
flip_5 = FlipCurve(Curve=crv_f_2)  # -> Curve, Flag
flip_6 = FlipCurve(Curve=crv_b_2)  # -> Curve, Flag
flip_7 = FlipCurve(Curve=crv_a_2)  # -> Curve, Flag
crv_sitting_srf_2 = Curve(crv_sitting_srf)
crv_10 = Curve(pline)
crv_11 = Curve(pline_2)
crv_12 = Curve(pline_9)
merge_7 = Merge(Data1=crv_10, Data2=crv_12, Data3=crv_11)

# ----
# Fiber Placement for Sitting Srf
crv_13 = Curve(pline_3)
crv_14 = Curve(pline_5)
crv_15 = Curve(pline_8)
merge_8 = Merge(Data2=crv_13, Data3=crv_14, Data4=crv_15)
join_6 = JoinCurves(Curves=flatten(merge_7), Preserve=False)
join_7 = JoinCurves(Curves=merge_8, Preserve=False)

# ----
# Fibers on Sitting Srf
base_layer_on_the_bottom = Curve(join_6)
reinforcement_layer_on_the_top = Curve(join_7)

# ---- group: Loads (Karamba3D)
loads = LoadsKaramba3D(Vector=Vector(0, 0, -1), LCase=0, mode="Gravity")

# ----
# Structural Analysis with Karamba
weave_21 = Weave(Pattern=[0, 1], Stream0=ln_3, Stream1=crv_5, NullGaps=False)  # -> simplify(Weave)
weave_22 = Weave(Pattern=[0, 1], Stream0=ln_4, Stream1=crv_6, NullGaps=False)  # -> simplify(Weave)
merge_9 = Merge(Data1=weave_21, Data2=weave_22)
join_8 = JoinCurves(Curves=merge_9, Preserve=False)  # -> simplify(Curves)
merge_10 = Merge(Data1=legs_geo, Data2=join_8)
bending_angle = Slider(101, range=0..180)
bending_hinges = Curve(simplify(ln))
bang_4 = ExplodeTree(Data=bending_hinges)  # -> Branch0, Branch1, Branch2
bang_5 = ExplodeTree(Data=legs_geo)  # -> Branch0, Branch1, Branch2
hinge_1 = Geometry(bang_4.Branch0)
hinge_2 = Geometry(bang_4.Branch1)
hinge_3 = Geometry(bang_4.Branch2)
leg_1 = Geometry(bang_5.Branch0)
leg_2 = Geometry(bang_5.Branch1)
leg_3 = Geometry(bang_5.Branch2)
rotax = RotateAxis(Geometry=legs_without_actuator_curves, Angle=degrees(bending_angle), Axis=bending_hinges)  # -> Geometry, Transform
merge_11 = Merge(Data1=sitting_crves_without_actuator_curves, Data2=rotax.Geometry)
join_9 = JoinCurves(Curves=flatten(merge_11), Preserve=False)  # -> simplify(Curves)
shift_15 = ShiftList(List=join_9, Shift=1, Wrap=True)
geo_5 = Geometry(shift_15)
item_6 = ListItem(List=geo_5, Index=0, Wrap=True)  # -> Item, Item1, Item2, Item3
geo_6 = Geometry(item_6.Item)
brep_2 = Brep(geo_5)
matselect = MaterialSelectionKaramba3D(menu=[dropdown(4), dropdown(1)])
panel_8 = Panel(matselect)
Z = UnitZ(Factor=1)
disassemble = DisassembleMaterialKaramba3D(Material=matselect)  # -> Material, TypeOfMaterial, FamilyNameOfMaterial, NameOfMaterial, ElemIdentifiers, Color, YoungsModulusKNCm2Dir12, InPlaneShearModulus_kN_cm2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
neg = Negative(Value=Z)
panel_9 = Panel("3950")
panel_10 = Panel("60")
cross_section = CrossSectionKaramba3D(
    FamilyNameOfCrossSection="DefaultCroSec",
    Material=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,
    Height_cm=9.6,
    UpperFlangeWidth_cm=10,
    LowerFlangeWidth_cm=10,
    UpperFlangeThickness_cm=0.8,
    LowerFlangeThickness_cm=0.8,
    WebThickness_cm=0.5,
    FilletRadius_cm=0,
    mode="I")
matprops = MaterialPropertiesKaramba3D(
    FamilyOfMaterial="fiber",
    Name="flax fiber",
    YoungsModulus_kN_cm2=21000,
    InPlaneShearModulus_kN_cm2=8076,
    TransverseShearModulus_kN_cm2=8076,
    SpecificWeight_kN_m3=78.5,
    CoefficientOfThermalExpansion_1_C=1e-05,
    YieldStrength_kN_cm2=23.5,
    mode="Isotrop")
joint = JointKaramba3D()
panel_11 = Panel(matprops)
crosec = CrossSectionKaramba3D(flatten(cross_section))
material = MaterialKaramba3D(flatten(matprops))

sitting_curves = Curve(simplify(sitting_area_boundary_curve_with_actuato))
legs_with_actuator = Geometry(merge_10)

# ---- group: Mesh Breps (Karamba3D)
mesh_breps = MeshBrepsKaramba3D(
    Brep=brep_2,
    MeshResolution=Slider(10, range=0..100),
    EdgeRefinementFactor=0.67,
    PointReduction=False,
    SmoothingStepSize=0,
    SmoothingIterations=5)  # -> simplify(Mesh), Info

# ----
# +Gradient Weaving
# CURVE A TO CURVE D
crv_d_2 = Curve(crv_d)
crv_a_4 = Curve(crv_a_2)
len_5 = Length(Curve=crv_d_2)
division_4 = Division(A=len_5, B="6")
number_slider_10 = Slider(0.5, range=0..1)
divide_13 = DivideCurve(Curve=crv_d_2, Count=division_4, Kinks=False)  # -> Points, Tangents, Parameters
divide_14 = DivideCurve(Curve=crv_a_4, Count=division_4, Kinks=False)  # -> Points, Tangents, Parameters
lng_2 = ListLength(List=divide_13.Points)
item_7 = ListItem(List=flatten(lng_2), Index=0, Wrap=True)
dom_16 = ConstructDomain(DomainStart=1, DomainEnd=number_slider_10)
range_10 = Range(Domain=dom_16, Steps=item_7)
rev = ReverseList(List=range_10)
cull_i_7 = CullIndex(List=rev, Indices=0, Wrap=True)
merge_12 = Merge(Data1=range_10, Data2=cull_i_7)  # -> flatten(Result)
c__gradientanchorselection = CSharpScript(initPointsA=divide_14.Points, initPointsB=divide_13.Points, secList=merge_12)  # -> out, oSelectedIndicesA, oSelectedPointsA, oSelectedIndicesB, oSelectedPointsB; inputs initPointsA: list of Point3d, initPointsB: list of Point3d, secList: list of Double
# ---------- c__gradientanchorselection: C# usings ----------
using System.IO;
using System.Text.RegularExpressions;
using System.Linq;
# ---------- c__gradientanchorselection: C# ----------
    //___________ This script selects two lists of points based on a gradient list defined by the user_________
    //___________ re_duque_11/04/22___________________________________________________________________________


    double numPoints = initPointsA.Count(); //total number of points in initPoints
    double numSection = secList.Count();
    List<int> SelectedPointsIndicesA = new List<int>();
    List<Point3d> SelectedPointsA = new List<Point3d>();
    List<int> SelectedPointsIndicesB = new List<int>();
    List<Point3d> SelectedPointsB = new List<Point3d>();
    int i = 0;

    Print("numSection=" + numSection.ToString());

    while (i < numPoints) // go through the list until reaches its end without defining the step size
    {

      Print("i=" + i.ToString());

      // add the i to the list
      SelectedPointsA.Add(initPointsA[i]); //adds current Point
      SelectedPointsIndicesA.Add(i); // adds current index
      SelectedPointsB.Add(initPointsB[i]); //adds current Point
      SelectedPointsIndicesB.Add(i);

      // which section are we in? Remap the indexes to their respective sections
      int mySection = (int) Math.Floor(i / numPoints * numSection); // i/numPoints gives the relative position of the index in the list.  (Math.Floor rounds down the number)

      Print("mySection=" + mySection.ToString());

      //what is the section density? calculate the skip factor: Density/1
      int skip = (int) Math.Round(1 / secList[mySection]); // secList[mySection] gives the skip value based on the list you defined with the densitity ratios

      // gets i value

      i = i + skip;


    }


    oSelectedPointsA = SelectedPointsA;
    oSelectedIndicesA = SelectedPointsIndicesA;

    oSelectedPointsB = SelectedPointsB;
    oSelectedIndicesB = SelectedPointsIndicesB;
# ---------- end c__gradientanchorselection ----------

number_slider_11 = Slider(0, range=0..10)
panel_12 = Panel("""0
1
1
0""")
shift_list = ShiftList(List=c__gradientanchorselection.oSelectedPointsB, Shift=number_slider_11, Wrap=False)
shift_list_2 = ShiftList(List=c__gradientanchorselection.oSelectedPointsA, Shift=number_slider_11, Wrap=False)
weave_23 = Weave(Pattern=panel_12, Stream0=c__gradientanchorselection.oSelectedPointsA, Stream1=shift_list, NullGaps=False)
weave_24 = Weave(Pattern=panel_12, Stream0=shift_list_2, Stream1=c__gradientanchorselection.oSelectedPointsB, NullGaps=False)
polyline = PolyLine(Vertices=weave_23, Closed=False)
polyline_2 = PolyLine(Vertices=weave_24, Closed=False)

# ----
# +Gradient Weaving
# CURVE B TO CURVE C
crv_c_2 = Curve(crv_c)
crv_b_4 = Curve(crv_b_2)
end_6 = EndPoints(Curve=crv_c_2)  # -> Start, End
len_6 = Length(Curve=crv_c_2)
pt_2 = Point(end_6.Start)
division_5 = Division(A=len_6, B="6")
divide_15 = DivideCurve(Curve=crv_c_2, Count=division_5, Kinks=False)  # -> Points, Tangents, Parameters
divide_16 = DivideCurve(Curve=crv_b_4, Count=division_5, Kinks=False)  # -> Points, Tangents, Parameters
lng_3 = ListLength(List=divide_15.Points)
item_8 = ListItem(List=flatten(lng_3), Index=0, Wrap=True)
dom_17 = ConstructDomain(DomainStart=1, DomainEnd=number_slider_10)
range_11 = Range(Domain=dom_17, Steps=item_8)
rev_2 = ReverseList(List=range_11)
cull_i_8 = CullIndex(List=rev_2, Indices=0, Wrap=True)
merge_13 = Merge(Data1=range_11, Data2=cull_i_8)  # -> flatten(Result)
c__gradientanchorselection_2 = CSharpScript(initPointsA=divide_16.Points, initPointsB=divide_15.Points, secList=merge_13)  # -> out, oSelectedIndicesA, oSelectedPointsA, oSelectedIndicesB, oSelectedPointsB; inputs initPointsA: list of Point3d, initPointsB: list of Point3d, secList: list of Double; same code as c__gradientanchorselection
panel_13 = Panel("""0
1
1
0""")
shift_list_3 = ShiftList(List=c__gradientanchorselection_2.oSelectedPointsB, Shift=number_slider_11, Wrap=False)
shift_list_4 = ShiftList(List=c__gradientanchorselection_2.oSelectedPointsA, Shift=number_slider_11, Wrap=False)
weave_25 = Weave(Pattern=panel_13, Stream0=c__gradientanchorselection_2.oSelectedPointsA, Stream1=shift_list_3, NullGaps=False)
weave_26 = Weave(Pattern=panel_13, Stream0=shift_list_4, Stream1=c__gradientanchorselection_2.oSelectedPointsB, NullGaps=False)
polyline_3 = PolyLine(Vertices=weave_25, Closed=False)
polyline_4 = PolyLine(Vertices=weave_26, Closed=False)

curvea_curved = Curve(polyline)

# ----
# Top Reinforcement Layer
panel_14 = Panel(eval_4.Point)
end_7 = EndPoints(Curve=pline_10)  # -> Start, End
end_8 = EndPoints(Curve=pline_11)  # -> Start, End
ln_9 = Line(StartPoint=end_7.End, EndPoint=end_8.Start)
pt_3 = Point(end_7.Start)
pt_4 = Point(end_8.Start)
merge_14 = Merge(Data1=curvea_curvef, Data2=curvea_curvef_2)
join_10 = JoinCurves(Curves=merge_14, Preserve=False)  # -> simplify(Curves)
curveb_curvec = Curve(polyline_3)
merge_15 = Merge(Data1=curvea_curved, Data2=curveb_curvec)
join_11 = JoinCurves(Curves=merge_15, Preserve=False)  # -> simplify(Curves)

# ----
# fibers on the legs
reinforcement_layer_2_on_the_top = Curve(join_11)
reinforcement_layer_1_on_the_top = Curve(join_10)
layer_bottom = Curve(crva_crvb)

# ----
# merged Geo
merge_16 = Merge(Data1=reinforcement_layer_on_the_top, Data2=base_layer_on_the_bottom)
merge_17 = Merge(Data1=layer_bottom, Data2=reinforcement_layer_1_on_the_top, Data3=reinforcement_layer_2_on_the_top)
merge_18 = Merge(Data1=merge_16, Data2=merge_17)

mjoin = MeshJoin(Meshes=mesh_breps.Mesh)
weld = WeldMesh(Mesh=mjoin, Angle=3.141592654)
panel_15 = Panel(weld)
demesh = DeconstructMesh(Mesh=weld)  # -> simplify(Vertices), Faces, Colours, Normals
pdecon = Deconstruct(Point=demesh.Vertices)  # -> XComponent, YComponent, ZComponent
sort_4 = SortList(Keys=pdecon.ZComponent, ValuesA=demesh.Vertices)  # -> reverse(Keys), reverse(ValuesA)
sort_5 = SortList(Keys=pdecon.ZComponent, ValuesA=demesh.Vertices)  # -> Keys, ValuesA
smaller = SmallerThan(FirstNumber=sort_4.Keys, SecondNumber="-5")  # -> SmallerThan, OrEqualTo
smaller_2 = SmallerThan(FirstNumber=sort_5.Keys, SecondNumber="-200")  # -> SmallerThan, OrEqualTo
dispatch = Dispatch(List=sort_4.ValuesA, DispatchPattern=smaller.SmallerThan)  # -> ListA, ListB
dispatch_2 = Dispatch(List=sort_5.ValuesA, DispatchPattern=smaller_2.SmallerThan)  # -> ListA, ListB
pt_5 = Point(dispatch_2.ListA)
pt_6 = Point(dispatch.ListB)
duppt_2 = RemoveDuplicatePts(Points=pt_5, Tolerance=0.01)
duppt_3 = RemoveDuplicatePts(Points=pt_6, Tolerance=0.01)
meshtoshell = MeshToShellKaramba3D(Mesh=weld, LimitDistance_m=0.005)  # -> Element, Points, Info
supp = SupportKaramba3D(PosInd=duppt_2, menu=[buttons(off, off, off, on, on, on)])
supp_2 = SupportKaramba3D(PosInd=duppt_3, menu=[buttons(on, on, on, off, off, off)])
element = ElementKaramba3D(meshtoshell.Element)
support = SupportKaramba3D(flatten([supp_2, supp]))

# ---- group: Loads (Karamba3D)
loads_2 = LoadsKaramba3D(ForceVector=neg, Local=False, PosInd=duppt_3, LCase=0, mode="Point")

loads_3 = LoadsKaramba3D(Vector=neg, Mesh=weld, LCase=0, mode="MeshLoad -Const.", menu=[buttons(off, on, off), buttons(on, on)])

# ----
load = LoadKaramba3D(flatten([loads, loads_3, loads_2]))

# ---- group: Assemble Model (Karamba3D)
assemble = AssembleModelKaramba3D(Elem=element, Support=support, Load=load, CrossSection=crosec, Material=material, LimitDistance_m=0.005)  # -> Model, Info, Mass_kg, CenterOfGravity

# ---- group: Analyze (Karamba3D)
analyze = AnalyzeKaramba3D(Model=assemble.Model)  # -> CalculatedModel, MaximumDisplacement_cm, ResultingForceOfGravity_kN, ElasticEnergy_kNm

# ---- group: Model View (Karamba3D)
modelview = ModelViewKaramba3D(Model=analyze.CalculatedModel, ResultFactors=1, ResultCase=-1)  # -> Model, DeformedMesh, DeformedAxes, DeformedModel

# ----
mesh = Mesh(modelview.DeformedMesh)
